% Simulink design studies test.mldatx for model WaterTankLevelControlDemo

study "DesignStudy": 9 simulations
  combinatorial set (9 points):
    "Variable_1": Variable(Name=Kp_Level), values 10:12 (3 points)
    "Variable_2": Variable(Name=Ki_Level), values 1.0:0.1:1.2 (3 points)